vi "BER.gvi"   [LabVIEW NXG 3.0.0]
inputs:
  "Output bit stream": i8[]
  "Input bit stream": i8[]
  "error in": error
  "Array in": f64[]
  "Reset BER": bool
outputs:
  "error out": error
  "current BER": f64
  "BER array": f64[]
  "Mean_BER": f64
  "BER graph": f64[]
  "Correct Size": bool
  "Output array size": i32
  "Input array size": i32
uses:
  NI::Analysis::Statistics::Mean (DBL).gvi
  NI::G Core::Error::Filter Error Code.gvi
diagram:
  Array Size(array=$"Output bit stream") -> (size(s)=w1)
  # Check if input sequence has expected length
  $"Output array size" <- w1
  Array Size(array=$"Input bit stream") -> (size(s)=w2)
  Is Equal(x=w1, y=w2) -> w3
  $"Correct Size" <- w3
  $"Input array size" <- w2
  Is Not Equal(x=$"Output bit stream", y=$"Input bit stream") -> w4
  Boolean To Integer(Boolean=w4) -> (0, 1=w5)
  To Double Precision Float(number=w5) -> w6
  # Calculate BER
  case ($"error in") {
    frame Error, Default {
      w7 = $"error in"
      w8 = -1
    }
    frame No Error {
      call "Mean (DBL).gvi"(x=w6, error in=$"error in") -> (mean=w8, error out=w7)
    }
  }
  $"current BER" <- w8
  case ($"Reset BER") {
    frame False, Default {
      w9 = $"Array in"
    }
    frame True {
      w9 = f64[] []
    }
  }
  Insert Into Array(inArray=w9, new=w8) -> w10
  $"BER graph" <- w10
  $"BER array" <- w10
  # Remove all values that are -1 from array. -1 is the value returned as BER when an error occured or no frame is detected.
  s1 = w10  # shift register
  while {
    Search 1D Array(1D array=s1, element=-1) -> (index of element=w11)
    Delete From Array(inArray=s1, index0=w11) -> w12
    Is Equal(x=w11, y=-1) -> w13
    next s1 = w12
    stop if w13
  }
  case (w7) {
    frame Error, Default {
      w14 = w7
      w15 = -1
    }
    frame No Error {
      call "Mean (DBL).gvi"(x=s1, error in=w7) -> (mean=w15, error out=w14)
    }
  }
  $Mean_BER <- w15
  call "Filter Error Code.gvi"(error in=w14, code to clear=-20003) -> (error out=w16)
  $"error out" <- w16
