vi "BarkerCode.gvi"   [LabVIEW NXG 3.0.0]
inputs:
  "barker code": enum{"5", "7", "11", "random"} = "random"
  "Concatinate?": bool = TRUE
outputs:
  "code": f64[]
  "length of one subcode": i32
  "subcodes": i32
panel indicators:
  "32-bit integer": i32
uses:
  NI::Analysis::Probability::Bernoulli Random.gvi
diagram:
  # Barker code
  case ($"barker code") {
    frame "5" {
      w1 = [1, 1, 1, -1, 1]
      w2 = default
      w3 = default
    }
    frame "7" {
      w1 = [1, 1, 1, -1, -1, 1, -1]
      w2 = default
      w3 = default
    }
    frame "11", Default {
      w1 = [1, 1, 1, -1, -1, -1, 1, -1, -1, 1, -1]
      w2 = default
      w3 = default
    }
    frame "random" {
      call "Bernoulli Random.gvi"(samples=80, p=0.5, seed=1, reset=TRUE) -> (Bernoulli random data=w4)
      To Long Integer(number=w4) -> w5
      Multiply(w5, 2) -> w6
      Decrement(x=w6) -> w7
      To Double Precision Float(number=w7) -> w1
      w2 = 2
      w3 = 80
    }
  }
  case ($"barker code") {
    frame Default {
      case ($"Concatinate?") {
        frame False, Default {
          w10 = 1
          w8 = w1
        }
        frame True {
          Build Array(w1, w1) -> w8
          w10 = 2
        }
      }
      Array Size(array=w1) -> (size(s)=w9)
    }
    frame "random" {
      Divide(x=w3, y=w2) -> w11: f64
      To Long Integer(number=w11) -> w9
      w8 = w1
      w10 = w2
    }
  }
  $code <- w8
  $subcodes <- w10
  $"length of one subcode" <- w9
  To Long Integer(number=$"barker code") -> w12
  $"32-bit integer" <- w12
