vi "BusyChannelDetector.gvi"   [LabVIEW NXG 3.0.0]
inputs:
  "channel input": c128[]
  "Threshold": f64
outputs:
  "busy channel": bool
  "Power signal": f64[]
  "estimated power": f64
diagram:
  call "PowerEstimator.gvi"(input signal=$"channel input") -> (estimated power=w1, Power signal=w2)
  $"estimated power" <- w1
  Is Greater(x=w1, y=$Threshold) -> w3
  $"busy channel" <- w3
  $"Power signal" <- w2
