vi "Downsampler.gvi"   [LabVIEW NXG 3.0.0]
inputs:
  "input signal": c128[]
  "error in": error
  "samples per symbol": f64
  "message length": i32
outputs:
  "output signal": c128[]
  "error out": error
uses:
  NI::Analysis::Resampling::Decimate (single shot, CDB).gvi
diagram:
  call "Decimate (single shot, CDB).gvi"(signal=$"input signal", decimating factor=$"samples per symbol", error in=$"error in") -> (decimated signal=w1, error out=w2)
  Array Subset(array=w1, length0=$"message length") -> w3
  $"output signal" <- w3
  $"error out" <- w2
