vi "FrameScrambler.gvi"   [LabVIEW NXG 3.0.0]
inputs:
  "input": u8[]
  "seed": i32 = 1
  "error in": error
outputs:
  "output": u8[]
  "error out": error
uses:
  NI::Analysis::Probability::Bernoulli Random.gvi
diagram:
  Array Size(array=$input) -> (size(s)=w1)
  call "Bernoulli Random.gvi"(samples=w1, p=0.5, seed=$seed, error in=$"error in", reset=TRUE) -> (Bernoulli random data=w2, error out=w3)
  $"error out" <- w3
  Logical Exclusive Or(w2, $input) -> w4
  $output <- w4
