vi "Interleaver.gvi"   [LabVIEW NXG 3.0.0]
inputs:
  "data in": i32[]
  "error in": error
  "selector": enum{"TX", "RX", "TX Block", "RX Block"} = "TX"
  "Coding": bool
  "Message length": i32
outputs:
  "data out": i32[]
  "error out": error
uses:
  NI::Analysis::Probability::Random Permutation.gvi
  NI::Modulation::MT Permute.gvi
  NI::Modulation::MT DePermute.gvi
  NI::Modulation::MT Block Interleave (Matrix).gvi
  NI::Modulation::MT Block DeInterleave (Matrix).gvi
diagram:
  case ($selector) {
    frame "TX" {
      case ($Coding) {
        frame False, Default {
          w3 = $"data in"
        }
        frame True {
          Array Size(array=$"data in") -> (size(s)=w4)
          # 2*Traceback depth fra Decoder
          Multiply(15, 2) -> w5
          Initialize Array(element=0, size=w5) -> w6
          Insert Into Array(inArray=$"data in", index0=w4, new=w6) -> w3
        }
      }
      Array Size(array=w3) -> (size(s)=w7)
      call "Random Permutation.gvi"(n=w7, start=0, seed=1, error in=$"error in", reset=TRUE) -> (random permutation=w8, error out=w9)
      call "MT Permute.gvi"(data in=w3, permutation array=w8, error in=w9) -> (data out=w2, error out=w1)
    }
    frame "RX" {
      case ($Coding) {
        frame False, Default {
          Array Subset(array=$"data in", length0=$"Message length") -> w10
        }
        frame True {
          # 2* Traceback depth
          Multiply(2, $"Message length") -> w11
          Add(w11, 30) -> w12
          Array Subset(array=$"data in", index0=0, length0=w12) -> w10
        }
      }
      Array Size(array=w10) -> (size(s)=w13)
      call "Random Permutation.gvi"(n=w13, start=0, seed=1, error in=$"error in", reset=TRUE) -> (random permutation=w14, error out=w15)
      call "MT DePermute.gvi"(data in=w10, permutation array=w14, error in=w15) -> (data out=w2, error out=w1)
    }
    frame "TX Block" {
      call "MT Block Interleave (Matrix).gvi"(reset?=TRUE, data in=$"data in", number of rows=16, number of columns=8, error in=$"error in") -> (data out=w2, error out=w1)
    }
    frame "RX Block" {
      call "MT Block DeInterleave (Matrix).gvi"(reset?=TRUE, data in=$"data in", number of rows=16, number of columns=8, error in=$"error in") -> (data out=w2, error out=w1)
    }
  }
  $"data out" <- w2
  $"error out" <- w1
