vi "MSE.gvi"   [LabVIEW NXG 3.0.0]
inputs:
  "IQ Reference signal": c128[]
  "IQ Input signal": c128[]
  "error in": error
  "Array in": f64[]
  "Reset MSE": bool
outputs:
  "error out": error
  "Accumulated MSE": f64
  "MSE Array": f64[]
uses:
  NI::G Core::Error::Is Error.gvi
  NI::Analysis::Statistics::Mean (DBL).gvi
diagram:
  call "Is Error.gvi"(error in=$"error in") -> (error?=w1)
  Array Size(array=$"IQ Input signal") -> (size(s)=w2)
  Is Less Or Equal To 0(x=w2) -> w3
  Logical Or(w1, w3) -> w4
  case (w4) {
    frame True {
      w5 = 0
      w6 = $"Array in"
      w7 = $"error in"
    }
    frame False {
      case ($"Reset MSE") {
        frame False, Default {
          w8 = $"Array in"
        }
        frame True {
          w8 = f64[] []
        }
      }
      Subtract(x=$"IQ Input signal", y=$"IQ Reference signal") -> w9
      Absolute Value(x=w9) -> w10
      Square(x=w10) -> w11
      call "Mean (DBL).gvi"(x=w11, error in=$"error in") -> (mean=w12, error out=w7)
      Insert Into Array(inArray=w8, new=w12) -> w6
      call "Mean (DBL).gvi"(x=w6) -> (mean=w5)
    }
  }
  $"MSE Array" <- w6
  $"Accumulated MSE" <- w5
  $"error out" <- w7
