vi "NormalizeVector.gvi"   [LabVIEW NXG 3.0.0]
inputs:
  "Vector": c128[]
outputs:
  "Normalized Vector": c128[]
diagram:
  # root mean square
  Absolute Value(x=$Vector) -> w1
  Square(x=w1) -> w2
  Add Array Elements(numeric array=w2) -> (sum=w3)
  Array Size(array=$Vector) -> (size(s)=w4)
  To Double Precision Float(number=w4) -> w5
  Divide(x=w3, y=w5) -> w6
  Square Root(x=w6) -> w7
  Is Not Equal To 0(x=w7) -> w8
  # Normalize by the RMS
  case (w8) {
    frame False, Default {
      w9 = $Vector
    }
    frame True {
      Complex To Polar(r * e^(i*theta)=$Vector) -> (r=w10, theta=w11)
      Divide(x=w10, y=w7) -> w12
      Polar To Complex(r=w12, theta=w11) -> (r * e^(i*theta)=w9)
    }
  }
  $"Normalized Vector" <- w9
