vi "NotifyError.gvi"   [LabVIEW NXG 3.0.0]
inputs:
  "notifier ref": Notifier<bool>
  "error in": error
  "Notify anyway": bool
outputs:
  "Error out": error
uses:
  NI::G Core::Error::Is Error.gvi
diagram:
  call "Is Error.gvi"(error in=$"error in") -> (error?=w1)
  Logical Or(w1, $"Notify anyway") -> w2
  case (w2) {
    frame False, Default {
      w3 = $"error in"
    }
    frame True {
      Send Notification(notification=TRUE, notifier=$"notifier ref")
      w3 = $"error in"
    }
  }
  $"Error out" <- w3
