vi "PowerEstimator.gvi"   [LabVIEW NXG 3.0.0]
inputs:
  "input signal": c128[]
outputs:
  "estimated power": f64
  "Power signal": f64[]
diagram:
  Array Size(array=$"input signal") -> (size(s)=w1)
  Initialize Array(element=0, size=w1) -> w2
  s1 = w2  # shift register
  for {
    w3 = each element of $"input signal"
    Absolute Value(x=w3) -> w4
    Square(x=w4) -> w5
    Add(w5, s1) -> w6
    next s1 = w6
  }
  $"Power signal" <- s1
  Add Array Elements(numeric array=s1) -> (sum=w7)
  Divide(x=w7, y=w1) -> w8
  $"estimated power" <- w8
