vi "PulseShaping.gvi"   [LabVIEW NXG 3.0.0]
inputs:
  "Signal in": c128[]
  "error in": error
  "Samples per symbol": f64
  "tx or rx": enum{"Tx", "Rx"} = "Tx"
  "filter parameter": f64 = 0.5
  "filter length": i32 = 8
outputs:
  "signal out": c128[]
  "error out": error
uses:
  NI::Modulation::MT Generate Filter Coefficients.gvi
  NI::Analysis::Operations::1D Convolution (CDB).gvi
diagram:
  call "MT Generate Filter Coefficients.gvi"(filter length=$"filter length", pulse shaping filter="Root Raised Cos", pulse shaping samples per symbol=$"Samples per symbol", matched samples per symbol=$"Samples per symbol", filter parameter=$"filter parameter", error in=$"error in", modulation type="PSK") -> (pulse shaping filter coefficients=w1, matched filter coefficients=w2, error out=w3)
  case ($"tx or rx") {
    frame "Tx", Default {
      w4 = w1
    }
    frame "Rx" {
      w4 = w2
    }
  }
  To Double Precision Complex(number=w4) -> w5
  call "1D Convolution (CDB).gvi"(x=$"Signal in", y=w5, error in=w3) -> (x * y=w6, error out=w7)
  $"signal out" <- w6
  $"error out" <- w7
