vi "RemoveSyncFrame.gvi"   [LabVIEW NXG 3.0.0]
inputs:
  "input": c128[]
  "samples per symbol": i32
  "sync frame index (bits)": i32
  "barker code": enum{"5", "7", "11", "random"} = "random"
outputs:
  "output": c128[]
diagram:
  call "BarkerCode.gvi"(barker code=$"barker code") -> (length of one subcode=w1, subcodes=w2)
  Multiply(w1, w2) -> w3
  Multiply(w3, $"samples per symbol") -> w4
  Multiply($"samples per symbol", $"sync frame index (bits)") -> w5
  # remove sync frame
  Delete From Array(inArray=$input, length (1)=w4, index0=w5) -> w6
  $output <- w6
