vi "SyncFrameGen.gvi"   [LabVIEW NXG 3.0.0]
inputs:
  "error in": error
  "sync sequence length": i32 = 128
outputs:
  "sync frame": f64[]
  "error out": error
uses:
  NI::Analysis::Probability::Bernoulli Random.gvi
diagram:
  call "Bernoulli Random.gvi"(samples=$"sync sequence length", p=0.5, seed=1, error in=$"error in", reset=TRUE) -> (Bernoulli random data=w1, error out=w2)
  To Double Precision Float(number=w1) -> w3
  Multiply(w3, 2) -> w4
  Subtract(x=w4, y=1) -> w5
  $"sync frame" <- w5
  $"error out" <- w2
