vi "ZeroPaddingInt.gvi"   [LabVIEW NXG 3.0.0]
inputs:
  "Input": u8[]
  "pad beginning": bool = TRUE
  "pad end": bool = TRUE
  "Padding length": i32
  "samples per symbol": i32
outputs:
  "output array": u8[]
diagram:
  Multiply($"Padding length", $"samples per symbol") -> w1
  Initialize Array(element=0, size=w1) -> w2
  case ($"pad beginning") {
    frame False, Default {
      w3 = $Input
    }
    frame True {
      Insert Into Array(inArray=$Input, index0=0, new=w2) -> w3
    }
  }
  case ($"pad end") {
    frame False, Default {
      w4 = w3
    }
    frame True {
      Array Size(array=w3) -> (size(s)=w5)
      Insert Into Array(inArray=w3, index0=w5, new=w2) -> w4
    }
  }
  $"output array" <- w4
