vi "BPSKDemod.gvi"   [LabVIEW NXG 3.0.0]
inputs:
  "symbols": c128[]
  "error in": error
outputs:
  "output bit stream": i8[]
  "error out": error
uses:
  NI::Modulation::MT Map PSK Symbols to Bits.gvi
diagram:
  call "MapBSPK.gvi"(error in=$"error in") -> (symbol map=w1, error out=w2)
  call "MT Map PSK Symbols to Bits.gvi"(symbols=$symbols, symbol map=w1, error in=w2) -> (output bit stream=w3, error out=w4)
  $"output bit stream" <- w3
  $"error out" <- w4
