vi "FrameSync.gvi"   [LabVIEW NXG 3.0.0]
inputs:
  "input signal": c128[]
  "barker code": enum{"5", "7", "11", "random"} = "random"
  "sync frame index (symbols)": i32 = 16
  "samples per symbol": f64 = 16
  "sync frame buffer (symbols)": i32 = 16
  "error in": error
  "Min correlation": f64
outputs:
  "output signal": c128[]
  "max index": f64
  "Training Subcodes": c128[]
  "error out": error
  "Correlation": f64[]
uses:
  NI::Analysis::Operations::1D Cross Correlation (CDB).gvi
  NI::Analysis::Measurement::Threshold Detector (1D DBL).gvi
  NI::G Core::Error::Build Error Cluster.gvi
diagram:
  To Long Integer(number=$"samples per symbol") -> w1
  Multiply($"sync frame buffer (symbols)", w1) -> w2
  call "BarkerCode.gvi"(barker code=$"barker code") -> (code=w3, length of one subcode=w4, subcodes=w5)
  To Double Precision Complex(number=w3) -> w6
  # w5: subcode count
  call "Upsampler.gvi"(Signal in=w6, Samples per symbol=$"samples per symbol", error in=$"error in") -> (Upsampled signal=w7, error out=w8)
  Multiply($"sync frame index (symbols)", w1) -> w9
  # w10: index - buffer
  Subtract(x=w9, y=w2) -> w10
  # w4: length of one subcode
  Array Size(array=w3) -> (size(s)=w11)
  # w11: sync frame length
  Multiply(w1, w11) -> w12
  Multiply(w2, 2) -> w13
  # w14: length + 2*buffer
  Add(w13, w12) -> w14
  # Reduce the search area
  Array Subset(array=$"input signal", index0=w10, length0=w14) -> w15
  Array Size(array=w7) -> (size(s)=w16)
  Array Size(array=w15) -> (size(s)=w17)
  Is Greater Than 0(x=w17) -> w18
  Decrement(x=w17) -> w19
  Add(w19, w16) -> w20
  Initialize Array(element=0, size=w20) -> w21
  case (w18) {
    frame False, Default {
      w22 = w8
      w23 = f64[] []
      w24 = c128[][] []
      w25 = TRUE
    }
    frame True {
      s1 = w21  # shift register
      s2 = w8  # shift register
      for (N = w5) (iteration -> i1) {
        call "Subcodemask.gvi"(input=w7, subcode length=w4, samples per symbol=$"samples per symbol", index=i1) -> (output=w26)
        # Moves the position of the subcode
        # so that the correlation indices overlap
        call "1D Cross Correlation (CDB).gvi"(x=w26, y=w15, error in=s2) -> (Rxy=w27, error out=w28)
        Array Subset(array=w27, index0=w16) -> w29
        Absolute Value(x=w29) -> w30
        Add(s1, w30) -> w31
        append w29 to w24
        next s1 = w31
        next s2 = w28
      }
      w22 = s2
      w23 = s1
      w25 = FALSE
    }
  }
  Multiply($"samples per symbol", w4) -> w32
  Multiply(w32, 0.1, w5) -> w33: f64
  Divide(x=w23, y=w33) -> w34
  # Find index and value of max correlation
  # Perform cross correlation between the signal and each of the subcodes
  call "Threshold Detector (1D DBL).gvi"(location mode="Index"(0), signal=w34, threshold=$"Min correlation", error in=w22) -> (locations=w35, count=w36, error out=w37)
  Array Index(array=w35) -> (out0[0]=w38)
  Increment(x=w38) -> w39
  Subtract(x=w39, y=w2) -> w40
  # Shift the signal with the sync index
  Array Subset(array=$"input signal", index0=w40) -> w41
  $"output signal" <- w41
  $Correlation <- w34
  $"max index" <- w39
  # Creates array of the correlated
  # subcodes at the max correlation
  for {
    w42 = each element of w24
    Array Index(array=w42) -> (out0[w38]=w44)
    append w44 to w43
  }
  $"Training Subcodes" <- w43
  Is Less Or Equal To 0(x=w36) -> w45
  Logical Or(w45, w25) -> w46
  # Throws an error if the correlation is below a threshold
  case (w46) {
    frame False, Default {
      w47 = w37
    }
    frame True {
      call "Build Error Cluster.gvi"(error in=w37, code=1234567, description="Frame sync failed") -> (error out=w47)
    }
  }
  $"error out" <- w47
