vi "FreqSync.gvi"   [LabVIEW NXG 3.0.0]
inputs:
  "input": c128[]
  "Training codes": c128[][]
  "Samples per symbol": f64 = 1
  "error in": error
  "barker code": enum{"5", "7", "11", "random"} = "random"
  "Frame index": i32
outputs:
  "output": c128[]
  "error out": error
  "phase drift": f64
  "intercept": f64
  "phase offset": f64
  "correction angles": f64[]
panel indicators:
  "best linear fit": f64[]
  "x - y": f64
  "Output_2": f64[]
uses:
  NI::Analysis::Conditioning::Unwrap Phase.gvi
  NI::Analysis::Statistics::Median.gvi
  NI::Analysis::Generation::Ramp Pattern by Samples.gvi
  NI::Analysis::Fitting::Linear Fit.gvi
  NI::Analysis::Geometry::Wrap Angle (Scalar DBL).gvi
diagram:
  call "BarkerCode.gvi"(barker code=$"barker code") -> (code=w1, length of one subcode=w2, subcodes=w3)
  # Least square estimation of phase with the reference code
  for (N -> w4) {
    w5 = each element of $"Training codes"
    Array Subset(array=w1, index0=w2, length0=w4) -> w7
    To Double Precision Complex(number=w7) -> w8
    Complex Conjugate(x + iy=w8) -> w9
    Multiply(w9, w5) -> w10
    Add Array Elements(numeric array=w10) -> (sum=w11)
    # Calculates the phase offset
    Complex To Polar(r * e^(i*theta)=w11) -> (theta=w12)
    append w12 to w6
  }
  $Output_2 <- w6
  call "Unwrap Phase.gvi"(input phase=w6) -> (unwrapped phase=w13)
  call "Median.gvi"(x=w13) -> (median=w14)
  Array Index(array=$"Training codes") -> (out0[0, _]=w15)
  Array Size(array=$"Training codes") -> (size(s)=w16)
  Array Index(array=w16) -> (out0[0]=w17)
  Decrement(x=w17) -> w18
  # Moose's algorithm
  for (N = w18) (iteration -> i1) {
    # Calculates the phase drift
    Increment(x=i1) -> w20
    Array Index(array=$"Training codes") -> (out0[w20, _]=w21)
    Array Size(array=w21) -> (size(s)=w22)
    Multiply(w22, w20) -> w23
    Complex Conjugate(x + iy=w15) -> w24
    Multiply(w24, w21) -> w25
    Add Array Elements(numeric array=w25) -> (sum=w26)
    Complex To Polar(r * e^(i*theta)=w26) -> (theta=w27)
    Divide(x=w27, y=w23) -> w28
    append w28 to w19
  }
  call "Unwrap Phase.gvi"(input phase=w19) -> (unwrapped phase=w29)
  call "Median.gvi"(x=w29) -> (median=w30)
  Multiply($"Samples per symbol", $"Frame index") -> w31
  Multiply(w30, w31) -> w32
  Subtract(x=w14, y=w32) -> w33
  $"x - y" <- w33
  Array Index(array=w16) -> (out0[1]=w34)
  Multiply(w34, w17)
  $"phase drift" <- w30
  disable {
    frame Enabled {
      w35 = default
    }
    frame Disabled {
      Multiply() -> (o=w36, out0=w37)
      Multiply(w3, w37) -> w38
      call "Ramp Pattern by Samples.gvi"(samples=w3, end=w38, exclude end=TRUE) -> (ramp pattern=w39)
      Complex To Polar(r * e^(i*theta)=[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]) -> (theta=w40)
      call "Unwrap Phase.gvi"(input phase=w40, phase unit="radian in, radian out"(0), error in=$"error in") -> (unwrapped phase=w41, error out=w42)
      # Create a linear array for the x axis
      # Compensate for phase offset
      # Estimate phase offset between sub codes
      Divide(x=f64 default, y=4) -> w43
      Add(w41, w43) -> w44
      call "Linear Fit.gvi"(method="Least Square"(0), y=w44, x=w39, error in=w42) -> (best linear fit=w45, slope=w46, intercept=w47, error out=w35)
      # phase/subcode length
      $"best linear fit" <- w45
      $intercept <- w47
      Multiply(w46, w36) -> w48
      Subtract(x=w47, y=w48) -> w49
      call "Wrap Angle (Scalar DBL).gvi"(angle=w49, wrapped angle range="-180 to 180 (-pi to pi)"(1), angle units="radian in, radian out"(0)) -> (wrapped angle=w50)
    }
  }
  Array Size(array=$input) -> (size(s)=w51)
  # n*phase/sub code length
  # from 0 to N
  Add(w51, 0) -> w52
  Multiply(w30, w52) -> w53
  # create phase compensation array
  call "Ramp Pattern by Samples.gvi"(samples=w52, end=w53, error in=w35) -> (ramp pattern=w54, error out=w55)
  Add(w54, w33) -> w56
  Negate(x=w56) -> w57
  Polar To Complex(r=1, theta=w57) -> (r * e^(i*theta)=w58)
  # compensate by multiplying with e^-j(n*phase/sub code length)
  Multiply($input, w58) -> w59
  $output <- w59
  # remove sync frame compensation
  $"error out" <- w55
  $"phase offset" <- w33
