vi "PacketDetector.gvi"   [LabVIEW NXG 3.0.0]
inputs:
  "input": c128[]
  "Power Threshold": f64 = 1e-07
  "index": i32
  "window length": i32
outputs:
  "detected?": bool
  "Calculated power": f64
diagram:
  To Double Precision Float(number=$"window length") -> w1
  # generate winow
  Array Subset(array=$input, index0=$index, length0=$"window length") -> w2
  Initialize Array(element=0, size=$"window length") -> w3
  # calculate mean power in window
  s1 = w3  # shift register
  for {
    w4 = each element of w2
    Absolute Value(x=w4) -> w5
    Square(x=w5) -> w6
    Add(w6, s1) -> w7
    next s1 = w7
  }
  Add Array Elements(numeric array=s1) -> (sum=w8)
  Divide(x=w8, y=w1) -> w9
  # frame if over threshold
  Is Greater(x=w9, y=$"Power Threshold") -> w10
  $"detected?" <- w10
  $"Calculated power" <- w9
