vi "PacketDetectorPreamble.gvi"   [LabVIEW NXG 3.0.0]
inputs:
  "input": c128[]
  "Correlation threshold": f64 = 1e-07
  "index": i32
  "error in": error
  "window length": i32
  "preamble code": enum{"5", "7", "11", "random"} = "random"
  "Samples per symbol": f64 = 1
outputs:
  "detected?": bool
  "max correlation": f64
  "error out": error
  "correlation preamble": f64[]
  "max index": i32
uses:
  NI::Analysis::Operations::1D Cross Correlation (CDB).gvi
diagram:
  # generate winow
  Array Subset(array=$input, index0=$index, length0=$"window length") -> w1
  call "BarkerCode.gvi"(barker code=$"preamble code", Concatinate?=FALSE) -> (code=w2)
  To Double Precision Complex(number=w2) -> w3
  call "Upsampler.gvi"(Signal in=w3, Samples per symbol=$"Samples per symbol", error in=$"error in") -> (Upsampled signal=w4, error out=w5)
  call "1D Cross Correlation (CDB).gvi"(x=w4, y=w1, error in=w5) -> (Rxy=w6, error out=w7)
  Absolute Value(x=w6) -> w8
  $"correlation preamble" <- w8
  Array Max And Min(array=w8) -> (max index(es)=w9, max value=w10)
  # frame if over threshold
  Is Greater(x=w10, y=$"Correlation threshold") -> w11
  $"detected?" <- w11
  $"error out" <- w7
  $"max correlation" <- w10
  $"max index" <- w9
