vi "Receiver.gvi"   [LabVIEW NXG 3.0.0]
inputs:
  "Signal in": c128[]
  "error in": error
  "IQ rate": f64
  "Interleaver mode": enum{"TX", "RX", "TX Block", "RX Block"} = "TX"
  "SFO": bool
  "message length (symbols)": i32 = 16
  "sync frame index (symbols)": i32 = 16
  "barker code": enum{"5", "7", "11", "random"} = "random"
  "Symbol rate (sym/s)": i32
  "Min correlation": f64
  "Frame sync": bool
  "Freq sync": bool
  "Interleaver": bool
  "decoding": bool
  "sync frame buffer (symbols)": i32 = 16
outputs:
  "output bit stream": i32[]
  "error out": error
  "Correlation": f64[]
  "IQ diagram": c128[]
  "Symbols downsampled (real)": f64[]
  "Baseband signal (real part)": cluster{"t0": f64, "dt": f64, "Y": f64[]}
  "Eye Diagram (real part)": cluster{"t0": f64, "dt": f64, "Y": f64[]}[]
uses:
  NI::G Core::Error::Filter Error Code.gvi
  NI::Modulation::MT Format Eye Diagram (complex).gvi
diagram:
  Divide(x=$"IQ rate", y=$"Symbol rate (sym/s)") -> w1
  To Long Integer(number=w1) -> w2
  call "NormalizeVector.gvi"(Vector=$"Signal in") -> (Normalized Vector=w3)
  # Matched filter
  case ($SFO) {
    frame False, Default {
      w4 = $"error in"
      w5 = w3
    }
    frame True {
      call "SFOSync.gvi"(input signal=w3, error in=$"error in") -> (output signal=w5, error out=w4)
    }
  }
  # Frame synch
  case ($"Frame sync") {
    frame False, Default {
      w6 = f64[] []
      w7 = w4
      w8 = w5
      w9 = c128[][] []
    }
    frame True {
      call "FrameSync.gvi"(input signal=w5, samples per symbol=w2, sync frame buffer (symbols)=$"sync frame buffer (symbols)", error in=w4, sync frame index (symbols)=$"sync frame index (symbols)", barker code=$"barker code", Min correlation=$"Min correlation") -> (output signal=w8, Correlation=w6, Training Subcodes=w9, error out=w7)
    }
  }
  Logical And($"Freq sync", $"Frame sync") -> w10
  # Frequency synch
  case (w10) {
    frame False, Default {
      w11 = w7
      w12 = w8
    }
    frame True {
      call "FreqSync.gvi"(input=w8, Training codes=w9, Samples per symbol=w2, Frame index=$"sync frame index (symbols)", error in=w7, barker code=$"barker code") -> (output=w12, error out=w11)
    }
  }
  # Downsample
  case ($"Frame sync") {
    frame False, Default {
      w13 = w12
    }
    frame True {
      call "RemoveSyncFrame.gvi"(input=w12, samples per symbol=w2, sync frame index (bits)=$"sync frame index (symbols)", barker code=$"barker code") -> (output=w13)
    }
  }
  call "Downsampler.gvi"(input signal=w13, error in=w11, samples per symbol=w2) -> (output signal=w14, error out=w15)
  case ($decoding) {
    frame False, Default {
      w16 = $"message length (symbols)"
    }
    frame True {
      Multiply(2, $"message length (symbols)") -> w16
    }
  }
  Array Subset(array=w14, index0=0, length0=w16) -> w17
  case (w15) {
    frame Error, Default {
      w18 = i8[] []
      w19 = w15
    }
    frame No Error {
      # Symbol mapping
      call "BPSKDemod.gvi"(symbols=w17, error in=w15) -> (output bit stream=w18, error out=w19)
    }
  }
  # Scrambler?
  call "FrameScrambler.gvi"(input=w18, error in=w19) -> (output=w20, error out=w21)
  case ($Interleaver) {
    frame False, Default {
      w22 = w20
      w23 = w21
    }
    frame True {
      call "Interleaver.gvi"(data in=w20, Message length=$"message length (symbols)", error in=w21, selector=$"Interleaver mode", Coding=$decoding) -> (data out=w22, error out=w23)
    }
  }
  case ($decoding) {
    frame False, Default {
      Array Subset(array=w22, length0=$"message length (symbols)") -> w24
      w25 = w23
    }
    frame True {
      # Decoding
      call "decode.gvi"(input data=w22, error in=w23) -> (output bit stream=w26, error out=w25)
      # trim remaining section
      Array Subset(array=w26, length0=$"message length (symbols)") -> w24
    }
  }
  $"output bit stream" <- w24
  $Correlation <- w6
  call "Filter Error Code.gvi"(error in=w25, code to clear=1234567) -> (error out=w27)
  # Ignore frame not found error
  $"error out" <- w27
  $"IQ diagram" <- w17
  Complex To Real Imaginary(x + iy=w17) -> (x=w28)
  $"Symbols downsampled (real)" <- w28
  Reciprocal(x=$"IQ rate") -> w29
  Complex To Real Imaginary(x + iy=w13) -> (x=w30)
  To Long Integer(number=w2) -> w31
  Multiply(w31, $"message length (symbols)") -> w32
  Array Subset(array=w30, length0=w32) -> w33
  # Plot signal
  Decimate Array(array=w33) -> (out1=w34)
  w35 = cluster{"t0": f64, "dt": f64, "Y": f64[]} {all zero or empty}
  Property Node(instance in=w35, "Y"=w34, "dt"=w29) -> (instance out=w36)  # Cluster Properties
  $"Baseband signal (real part)" <- w36
  call "MT Format Eye Diagram (complex).gvi"(waveform=w36, symbol rate=$"IQ rate", eye length=2) -> (eye diagram=w37)
  $"Eye Diagram (real part)" <- w37
