vi "ReceiverBlock.gvi"   [LabVIEW NXG 3.0.0]
panel controls:
  "IQ rate": f64 = 160000
  "carrier frequency": f64 = 915000000
  "gain (dB)": f64 = 10
  "active antenna": string = "RX2"
  "Device names": string = "USRP_06"
  "number of samples per USRP fetch": i64 = 20000
  "RF Channel": string = "1"
  "Symbol rate (sym/s)": i32 = 10000
  "filter parameter": f64 = 0.5
  "filter length": i32 = 8
  "message length (symbols)": i32 = 88
  "sync frame index (symbols)": i32 = 44
  "Power Threshold": f64 = 0.001
  "Min correlation": f64
  "Frame sync": bool = TRUE
  "Freq sync": bool = TRUE
  "barker code": enum{"5", "7", "11", "random"} = "random"
  "Stop_RX_2": bool
  "Reset BER": bool
  "decoding": bool
  "Receive sound": bool
  "Interleaver": bool
panel indicators:
  "actual IQ rate": f64
  "actual carrier frequency": f64
  "actual gain (dB)": f64
  "error out": error
  "enqueueing iteration": i32
  "dequeueing iteration": i32
  "Baseband signal (real)": cluster{"t0": f64, "dt": f64, "Y": f64[]}
  "IQ diagram": c128[]
  "Baseband signal (absolute value)": f64[]
  "Power of signal": f64
  "samples/symbol": f64
  "sync frame correlation": f64[]
  "BER graph": f64[]
  "Mean_BER": f64
  "current BER": f64
  "Input array size": i32
  "Output array size": i32
  "Correct Size": bool
  "Symbols downsampled": f64[]
  "string": string
uses:
  NI::USRP::niUSRP Open Rx Session.gvi
  NI::USRP::niUSRP Configure Signal.gvi
  NI::USRP::niUSRP Initiate.gvi
  NI::USRP::niUSRP Fetch Rx Data (CDB).gvi
  NI::Modulation::MT Pack Bits.gvi
  NI::USRP::niUSRP Abort.gvi
  NI::USRP::niUSRP Close Session.gvi
diagram:
  w1 = $"RF Channel"
  call "niUSRP Open Rx Session.gvi"(device names=$"Device names") -> (session handle out=w2, error out=w3)
  Property Node(instance in=w2, "niUSRP"=w1, error in=w3) -> (error out=w4, instance out=w5)
  call "niUSRP Configure Signal.gvi"(active antenna=$"active antenna", session handle=w5, error in=w4, IQ rate=$"IQ rate", carrier frequency=$"carrier frequency", gain=$"gain (dB)", channel list=w1) -> (session handle out=w6, error out=w7, coerced IQ rate=w8, coerced carrier frequency=w9, coerced gain=w10)
  call "niUSRP Initiate.gvi"(session handle=w6, error in=w7) -> (session handle out=w11, error out=w12)
  Obtain Notifier(element data type=bool TRUE, error in=w12, name="error") -> (error out=w13, notifier out=w14)
  Obtain Queue(element data type=c128[] [], error in=w13) -> (error out=w15, queue out=w16)
  w17 = $"number of samples per USRP fetch"
  s1 = w15  # shift register
  s2 = w16  # shift register
  while (iteration -> i1) {
    Get Notifier Status(notifier=w14) -> (latest notification=w18)
    # Producer loop
    case (w18) {
      frame True {
        w19 = w11
        w20 = s2
        w21 = s1
      }
      frame False {
        call "niUSRP Fetch Rx Data (CDB).gvi"(session handle=w11, error in=s1, number of samples=w17, channel list=w1) -> (session handle out=w19, error out=w22, data=w23)
        Enqueue Element(element=w23, error in=w22, queue=s2) -> (error out=w21, queue out=w20)
        call "NotifyError.gvi"(notifier ref=w14, error in=w21)
      }
    }
    $"enqueueing iteration" <- i1
    next s1 = w21
    next s2 = w20
    stop if w18
  }
  Obtain Queue(element data type=u8[] [], error in=w13) -> (error out=w24, queue out=w25)
  s3 = w15  # shift register
  s4 = w16  # shift register
  s5 = uninitialised  # shift register
  while (iteration -> i2) {
    Get Notifier Status(notifier=w14) -> (latest notification=w26, notifier out=w27)
    # Consumer loop
    case (w26) {
      frame True {
        w28 = s4
        w29 = s3
        w30 = s5
      }
      frame False {
        Divide(x=w8, y=$"Symbol rate (sym/s)") -> w31
        $"samples/symbol" <- w31
        Dequeue Element(error in=s3, queue=s4) -> (element=w32, error out=w33, queue out=w28)
        Absolute Value(x=w32) -> w34
        $"Baseband signal (absolute value)" <- w34
        call "BusyChannelDetector.gvi"(channel input=w32, Threshold=$"Power Threshold") -> (busy channel=w35, estimated power=w36)
        case (w35) {
          frame False, Default {
            w37 = w33
            w38 = default
          }
          frame True {
            call "Receiver.gvi"(Interleaver=$Interleaver, Signal in=w32, filter length=$"filter length", filter parameter=$"filter parameter", IQ rate=w8, Symbol rate (sym/s)=$"Symbol rate (sym/s)", Min correlation=$"Min correlation", error in=w33, message length (symbols)=$"message length (symbols)", sync frame index (symbols)=$"sync frame index (symbols)", barker code=$"barker code", Frame sync=$"Frame sync", Freq sync=$"Freq sync", decoding=$decoding) -> (IQ diagram=w39, Symbols downsampled (real)=w40, output bit stream=w38, Correlation=w41, Baseband signal (real part)=w42, error out=w37)
            $"sync frame correlation" <- w41
            $"Baseband signal (real)" <- w42
            $"Symbols downsampled" <- w40
            $"IQ diagram" <- w39
          }
        }
        case ($"Receive sound") {
          frame False, Default {
            call "Example signal.gvi"(message length (bits)=$"message length (symbols)") -> (output bit stream=w43)
            call "BER.gvi"(Output bit stream=w38, Input bit stream=w43, Array in=s5, error in=w37, Reset BER=$"Reset BER") -> (Correct Size=w44, Output array size=w45, Input array size=w46, current BER=w47, Mean_BER=w48, BER graph=w49, BER array=w30, error out=w29)
            $"current BER" <- w47
            $Mean_BER <- w48
            $"BER graph" <- w49
            $"Input array size" <- w46
            $"Output array size" <- w45
            $"Correct Size" <- w44
          }
          frame True {
            Enqueue Element(element=w38, error in=w37, queue=w25) -> (error out=w29)
            Array Size(array=w38) -> (size(s)=w50)
            Is Greater Than 0(x=w50) -> w51
            case (w51) {
              frame False, Default { }
              frame True {
                call "MT Pack Bits.gvi"(input bit stream=w38, bits per integer=8, packed bit order="MSB first", integer format="Unsigned") -> (output integers=w52)
                Byte Array To String(encoding="Extended ASCII", unsigned byte array=w52) -> (string=w53)
                $string <- w53
              }
            }
            w30 = s5
          }
        }
        call "NotifyError.gvi"(notifier ref=w27, Notify anyway=$Stop_RX_2, error in=w29)
        $"Power of signal" <- w36
      }
    }
    $"dequeueing iteration" <- i2
    next s3 = w29
    next s4 = w28
    next s5 = w30
    stop if w26
  }
  Release Queue(error in=s3, queue=s4) -> (error out=w54)
  call "niUSRP Abort.gvi"(session handle=w19, error in=w54) -> (session handle out=w55, error out=w56)
  call "niUSRP Close Session.gvi"(session handle=w55, error in=w56) -> (error out=w57)
  $"error out" <- w57
  $"actual IQ rate" <- w8
  $"actual carrier frequency" <- w9
  $"actual gain (dB)" <- w10
  call "Sink.gvi"(queue=w25, notifier ref=w14, error in=w24, net address_2="127.0.0.1", sink port=36363)
