vi "SFOSync.gvi"   [LabVIEW NXG 3.0.0]
inputs:
  "input signal": c128[]
  "error in": error
outputs:
  "output signal": c128[]
  "error out": error
  "Estimated phase": f64
  "best linear fit": f64[]
panel indicators:
  "error out_2": error
  "correction angles": f64[]
  "ramp pattern": f64[]
  "slope": f64
  "intercept": f64
  "dx(t)/dt": f64[]
  "mean": f64
  "magnitude": T1
  "magnitude_2": T1
types:
  T1 = cluster{"f0": f64, "df": f64, "magnitude": f64[]}
uses:
  NI::Analysis::Filtering::Butterworth Filter Design.gvi
  NI::Analysis::Filtering::Zero Phase Filtering (CDB).gvi
  NI::Analysis::Measurement::FFT Spectrum (Mag-Phase) (1D CDB).gvi
  NI::Analysis::Statistics::Median.gvi
  NI::Analysis::Conditioning::Unwrap Phase.gvi
  NI::Analysis::Generation::Ramp Pattern by Samples.gvi
  NI::Analysis::Fitting::Linear Fit.gvi
diagram:
  call "Butterworth Filter Design.gvi"(filter type="Lowpass", low cutoff frequency=0.02, order=4, filter structure option="IIR 4th Order"(1)) -> (filter=w1)
  Array Size(array=$"input signal") -> (size(s)=w2)
  Multiply(400, 2) -> w3
  Subtract(x=w2, y=w3) -> w4
  Array Subset(array=$"input signal", index0=400, length0=w4) -> w5
  Square(x=w5) -> w6
  call "Zero Phase Filtering (CDB).gvi"(signal=w6, filter=w1) -> (filtered signal=w7)
  call "FFT Spectrum (Mag-Phase) (1D CDB).gvi"(signal=w7) -> (magnitude=w8)
  $magnitude_2 <- w8
  call "FFT Spectrum (Mag-Phase) (1D CDB).gvi"(signal=w6) -> (magnitude=w9)
  $magnitude <- w9
  Complex To Polar(r * e^(i*theta)=w7) -> (theta=w10)
  s1 = uninitialised  # shift register
  for {
    w11 = each element of w10
    Subtract(x=w11, y=s1) -> w13
    Divide(x=w13, y=2) -> w14
    append w14 to w12
    next s1 = w11
  }
  Array Subset(array=w12, index0=1) -> w15
  $"dx(t)/dt" <- w15
  Absolute Value(x=w15) -> w16
  call "Median.gvi"(x=w16) -> (median=w17)
  $"Estimated phase" <- w17
  call "Unwrap Phase.gvi"(input phase=w10, phase unit="radian in, radian out"(0), error in=$"error in") -> (unwrapped phase=w18, error out=w19)
  Divide(x=w18, y=2) -> w20
  Array Size(array=w20) -> (size(s)=w21)
  call "Ramp Pattern by Samples.gvi"(samples=w21, end=w21) -> (ramp pattern=w22)
  call "Linear Fit.gvi"(y=w20, x=w22) -> (best linear fit=w23, intercept=w24)
  $"best linear fit" <- w23
  $"error out" <- w19
  $slope <- w17
  $intercept <- w24
  Array Size(array=$"input signal") -> (size(s)=w25)
  Multiply(w17, w25) -> w26
  # create phase compensation array
  call "Ramp Pattern by Samples.gvi"(samples=w25, end=w26) -> (ramp pattern=w27, error out=w28)
  Negate(x=w27) -> w29
  Polar To Complex(r=1, theta=w29) -> (r * e^(i*theta)=w30)
  # compensate by multiplying with e^-j(n*phase/sub code length)
  Multiply($"input signal", w30) -> w31
  $"output signal" <- w31
  $mean <- w17
  $"ramp pattern" <- w27
  $"error out_2" <- w28
