vi "Sink.gvi"   [LabVIEW NXG 3.0.0]
inputs:
  "error in": error
  "queue": Queue<u8[]>, required
  "sink port": u16 = 36363, required
  "net address_2": string = "127.0.0.1", required
  "notifier ref": Notifier<bool>, required
  "Pack bits": bool = TRUE
outputs:
  "sent output": i32[]
  "error out": error
panel indicators:
  "sink iteration": i32
uses:
  NI::Modulation::MT Pack Bits.gvi
diagram:
  Udp Open(error in=$"error in", net address=$"net address_2", port=0) -> (connection ID=w1, error out=w2)
  s1 = w2  # shift register
  s2 = w1  # shift register
  s3 = $queue  # shift register
  s4 = uninitialised  # shift register
  while (iteration -> i1) {
    Get Notifier Status(notifier=$"notifier ref") -> (latest notification=w3)
    case (w3) {
      frame False, Default {
        Dequeue Element(error in=s1, queue=s3, timeout in ms=100) -> (element=w8, error out=w9, queue out=w4)
        Array Size(array=s4) -> (size(s)=w10)
        Is Greater Or Equal(x=w10, y=4096) -> w11
        case (w11) {
          frame False, Default {
            Insert Into Array(inArray=s4, index0=w10, new=w8) -> w7
            w12 = w9
            w13 = u8[] []
            w6 = s2
          }
          frame True {
            # Pack bit stream into bytes
            case ($"Pack bits") {
              frame False, Default {
                w14 = w9
                w13 = s4
              }
              frame True {
                call "MT Pack Bits.gvi"(input bit stream=s4, bits per integer=8, packed bit order="LSB first", integer format="Unsigned", error in=w9) -> (output integers=w13, error out=w14)
              }
            }
            # Send packets over UDP
            Udp Write Binary(address=$"net address_2", connection ID=s2, data in=w13, error in=w14, port or service name=$"sink port", timeout ms=100) -> (connection ID out=w6, error out=w12)
            w7 = w8
          }
        }
        call "NotifyError.gvi"(notifier ref=$"notifier ref", error in=w12) -> (Error out=w5)
        $"sent output" <- w13
      }
      frame True {
        w4 = s3
        w5 = s1
        w6 = s2
        w7 = s4
      }
    }
    $"sink iteration" <- i1
    next s1 = w5
    next s2 = w6
    next s3 = w4
    next s4 = w7
    stop if w3
  }
  Udp Close(connection ID=s2, error in=s1) -> (error out=w15)
  $"error out" <- w15
