vi "Subcodemask.gvi"   [LabVIEW NXG 3.0.0]
inputs:
  "input": c128[]
  "index": i32
  "samples per symbol": f64
  "subcode length": i32
outputs:
  "output": c128[]
diagram:
  To Long Integer(number=$"samples per symbol") -> w1
  Multiply(w1, $index) -> w2
  Array Size(array=$input) -> (size(s)=w3)
  Initialize Array(element=0+0i, size=w3) -> w4
  Multiply(w1, $"subcode length") -> w5
  Initialize Array(element=1+1i, size=w5) -> w6
  Replace Array Subset(inArray=w4, index=w2, new=w6) -> w7
  # masks the rest of the code with 0
  # masks the subcode of interest with 1
  Multiply($input, w7) -> w8
  $output <- w8
