vi "preambleInserter.gvi"   [LabVIEW NXG 3.0.0]
inputs:
  "Signal in": c128[]
  "Preamble code": enum{"5", "7", "11", "random"} = "random"
outputs:
  "signal out": c128[]
diagram:
  call "BarkerCode.gvi"(barker code=$"Preamble code", Concatinate?=FALSE) -> (code=w1)
  To Double Precision Complex(number=w1) -> w2
  Array Size(array=w1) -> (size(s)=w3)
  Insert Into Array(inArray=w2, index0=w3, new=$"Signal in") -> w4
  $"signal out" <- w4
