vi "repacketizer.gvi"   [LabVIEW NXG 3.0.0]
panel controls:
  "array": u8[]
  "packet size": i32
  "last bits": u8[]
panel indicators:
  "next bits": u8[]
  "packets": u8[][]
diagram:
  Array Size(array=$array) -> (size(s)=w1)
  w2 = $"packet size"
  Quotient And Remainder(x=w1, y=w2) -> (floor(x/y)=w3, x-y*floor(x/y)=w4)
  Subtract(x=w1, y=w4) -> w5
  Array Subset(array=$array, index0=w5) -> w6
  $"next bits" <- w6
  Insert Into Array(inArray=$array, index0=0, new=$"last bits") -> w7
  Round Toward Negative Infinity(x=w3) -> w8
  s1 = 0  # shift register
  for (N = w8) {
    Multiply(w2, s1) -> w10
    Array Subset(array=w7, index0=w10, length0=w2) -> w11
    Increment(x=s1) -> w12
    append w11 to w9
    next s1 = w12
  }
  $packets <- w9
