vi "Channel_basic.gvi"   [LabVIEW NXG 3.0.0]
inputs:
  "inputSignal": cluster{"t0": f64, "dt": f64, "Y": c128[]} = {"t0"=0, "dt"=1, "Y"=[]}
  "error in": error
  "ChannelConfig": T2 = {20, 1, 16, 0, 1, 0}
outputs:
  "signalOutput": cluster{"t0": f64, "dt": f64, "Y": c128[]}
  "error out": error
types:
  T1 = cluster{"Eb/No": f64, "bits per symbol": i32, "samples per symbol": i32}
  T2 = cluster{"Noise": T1, "Frequency offset": cluster{"Frequency offset": f64}, "Timing": cluster{"Relation to fs": f64}, "Sampling rate": cluster{"fs": f64}}
uses:
  NI::Modulation::MT Add AWGN.gvi
diagram:
  Property Node(instance in=$ChannelConfig) -> ("Noise"=w1, "Frequency offset"=w2, "Timing"=w3, "Sampling rate"=w4)
  Property Node(instance in=w3) -> ("Relation to fs"=w5)
  Property Node(instance in=w4) -> ("fs"=w6)
  Property Node(instance in=w2) -> ("Frequency offset"=w7)
  Property Node(instance in=w1) -> ("samples per symbol"=w8, "bits per symbol"=w9, "Eb/No"=w10)
  Property Node(instance in=$inputSignal) -> ("t0"=w11, instance out=w12)
  call "MT Add AWGN.gvi"(input complex waveform=w12, samples per symbol=w8, bits per symbol=w9, eb/n0=w10, error in=$"error in") -> (output complex waveform=w13, error out=w14)
  Property Node(instance in=w13) -> ("Y"=w15)
  call "FreqOffset.gvi"(inputSignal=w15, fs=w6, freq_offset=w7, error in=w14) -> (shiftedSignal=w16, error out=w17)
  call "TimeOffset.gvi"(inputSignal=w16, Relation to fs=w5, error in=w17) -> (outputSignal=w18, error out=w19)
  $"error out" <- w19
  Multiply(w6, w5) -> w20
  Property Node(instance in=w12, "Y"=w18, "dt"=w20, "t0"=w11) -> (instance out=w21)
  $signalOutput <- w21
