vi "Interleaver test.gvi"   [LabVIEW NXG 3.0.0]
panel controls:
  "stop": bool
  "message length (bits)": i32 = 1000
  "Add error burst": bool
panel indicators:
  "Diff. before TX vs after RX Interl.": i32[]
  "Diff. before TX vs after TX Interl.": i32[]
diagram:
  while {
    call "Example signal.gvi"(message length (bits)=$"message length (bits)") -> (output bit stream=w1)
    To Long Integer(number=w1) -> w2
    call "Interleaver.gvi"(data in=w2, selector="TX") -> (data out=w3)
    Initialize Array(element=0, size=10) -> w4
    case ($"Add error burst") {
      frame False, Default {
        w5 = w3
      }
      frame True {
        Delete From Array(inArray=w3, length (1)=10, index0=30) -> w6
        Insert Into Array(inArray=w6, index0=30, new=w4) -> w5
      }
    }
    call "Interleaver.gvi"(data in=w5, selector="RX") -> (data out=w7)
    Subtract(x=w2, y=w7) -> w8
    $"Diff. before TX vs after RX Interl." <- w8
    Subtract(x=w2, y=w5) -> w9
    $"Diff. before TX vs after TX Interl." <- w9
    stop if $stop
  }
