vi "System test.gvi"   [LabVIEW NXG 3.0.0]
panel controls:
  "Barker insert index": i32 = 44
  "filter parameter": f64 = 0.5
  "filter length": i32 = 8
  "IQ rate": f64 = 160000
  "Symbol rate (sym/s)": i32 = 10000
  "ChannelConfig": T2 = {20, 1, 16, 0, 1, 10000}
  "message length (symbols)": i32 = 88
  "Min correlation": f64
  "Frame sync": bool
  "Reset BER": bool
  "Channel": bool
  "Stop": bool
  "Barker code": enum{"5", "7", "11", "random"} = "random"
  "Freq sync": bool
  "decode": bool
  "Padding length": i32 = 100
  "encode": bool
  "Interleaver": bool
  "Reset MSE": bool
panel indicators:
  "IQ diagram": c128[]
  "Baseband signal (real part)": cluster{"t0": f64, "dt": f64, "Y": f64[]}
  "Input bit stream": i8[]
  "IQ diagram_2": c128[]
  "Correlation": f64[]
  "BER graph": f64[]
  "Mean_BER": f64
  "current BER": f64
  "Input array size": i32
  "Output array size": i32
  "Correct Size": bool
  "error out": error
  "symbols downsampled": f64[]
  "MSE Graph": f64[]
  "Accumulated MSE": f64
types:
  T1 = cluster{"Eb/No": f64, "bits per symbol": i32, "samples per symbol": i32}
  T2 = cluster{"Noise": T1, "Frequency offset": cluster{"Frequency offset": f64}, "Timing": cluster{"Relation to fs": f64}, "Sampling rate": cluster{"fs": f64}}
uses:
  NI::G Core::Error::Display Error.gvi
diagram:
  s1 = uninitialised  # shift register
  s2 = uninitialised  # shift register
  while {
    call "Example signal.gvi"(message length (bits)=$"message length (symbols)") -> (output bit stream=w1)
    call "Transmitter.gvi"(filter parameter=$"filter parameter", filter length=$"filter length", Interleaver=$Interleaver, input bit stream=w1, IQ rate=$"IQ rate", Symbol rate (sym/s)=$"Symbol rate (sym/s)", Frame sync=$"Frame sync", Barker code=$"Barker code", Barker insert index=$"Barker insert index", encode=$encode) -> (signal out=w2, IQ diagram=w3, error out=w4)
    $"IQ diagram" <- w3
    Divide(x=1, y=$"Symbol rate (sym/s)") -> w5
    Divide(x=$"IQ rate", y=$"Symbol rate (sym/s)") -> w6
    call "ZeroPaddingDbl.gvi"(Input=w2, Padding length=$"Padding length", samples per symbol=w6) -> (output array=w7)
    Build Cluster(0, w5, w7) -> w8
    case ($Channel) {
      frame False, Default {
        w9 = w8
        w10 = w4
      }
      frame True {
        call "Channel_basic.gvi"(inputSignal=w8, ChannelConfig=$ChannelConfig, error in=w4) -> (signalOutput=w9, error out=w10)
      }
    }
    Property Node(instance in=w9) -> ("Element 3"=w11)
    call "Receiver.gvi"(Interleaver=$Interleaver, Signal in=w11, filter length=$"filter length", filter parameter=$"filter parameter", IQ rate=$"IQ rate", Symbol rate (sym/s)=$"Symbol rate (sym/s)", Min correlation=$"Min correlation", error in=w10, message length (symbols)=$"message length (symbols)", sync frame index (symbols)=$"Barker insert index", barker code=$"Barker code", Frame sync=$"Frame sync", Freq sync=$"Freq sync", decoding=$decode) -> (IQ diagram=w12, Symbols downsampled (real)=w13, output bit stream=w14, Correlation=w15, Baseband signal (real part)=w16, error out=w17)
    Absolute Value(x=w15) -> w18
    $Correlation <- w18
    $"Baseband signal (real part)" <- w16
    $"symbols downsampled" <- w13
    $"IQ diagram_2" <- w12
    call "MSE.gvi"(Reset MSE=$"Reset MSE", IQ Input signal=w12, IQ Reference signal=w3, Array in=s2) -> (Accumulated MSE=w19, MSE Array=w20)
    $"Accumulated MSE" <- w19
    $"Input bit stream" <- w1
    $"MSE Graph" <- w20
    call "BER.gvi"(Output bit stream=w14, Input bit stream=w1, Array in=s1, error in=w17, Reset BER=$"Reset BER") -> (Correct Size=w21, Output array size=w22, Input array size=w23, current BER=w24, Mean_BER=w25, BER graph=w26, BER array=w27, error out=w28)
    $"current BER" <- w24
    $Mean_BER <- w25
    $"BER graph" <- w26
    $"error out" <- w28
    $"Input array size" <- w23
    Wait(time to wait=100)
    $"Output array size" <- w22
    $"Correct Size" <- w21
    call "Display Error.gvi"(error in=w28) -> (error?=w29)
    Logical Or(w29, $Stop) -> w30
    next s1 = w27
    next s2 = w20
    stop if w30
  }
