vi "TestBER.gvi"   [LabVIEW NXG 3.0.0]
panel controls:
  "Reset BER": bool
  "message length (bits)": i32 = 1000
  "message length (bits)_2": i32 = 1000
  "Noise [dB]": f64 = 1
panel indicators:
  "current BER": f64
  "Mean_BER": f64
  "BER graph": f64[]
  "Correct Size": bool
  "Input array size": i32
  "Reference array size": i32
  "Array": i8[]
  "Array_2": i32[]
  "Graph": i8[]
  "Graph_2": i32[]
uses:
  NI::Analysis::Generation::Gaussian White Noise Waveform.gvi
  NI::G Core::Error::Is Error.gvi
diagram:
  s1 = uninitialised  # shift register
  while {
    call "Example signal.gvi"(message length (bits)=$"message length (bits)") -> (output bit stream=w1)
    $Graph <- w1
    Power Of 10(x=$"Noise [dB]") -> w2
    call "Gaussian White Noise Waveform.gvi"(samples=$"message length (bits)_2", standard deviation=w2) -> (Gaussian white noise=w3)
    Property Node(instance in=w3) -> ("Y"=w4)
    call "Example signal.gvi"(message length (bits)=$"message length (bits)_2") -> (output bit stream=w5)
    Add(w5, w4) -> w6
    Array Max And Min(array=w6) -> (max value=w7)
    Divide(x=w6, y=w7) -> w8
    To Long Integer(number=w8) -> w9
    call "BER.gvi"(Output bit stream=w1, Input bit stream=w9, Array in=s1, Reset BER=$"Reset BER") -> (Correct Size=w10, Output array size=w11, Input array size=w12, current BER=w13, Mean_BER=w14, BER graph=w15, BER array=w16, error out=w17)
    $"current BER" <- w13
    $Mean_BER <- w14
    $"BER graph" <- w15
    $Array <- w1
    call "Is Error.gvi"(error in=w17) -> (error?=w18)
    $Array_2 <- w9
    $Graph_2 <- w9
    $"Reference array size" <- w12
    $"Input array size" <- w11
    $"Correct Size" <- w10
    next s1 = w16
    stop if w18
  }
