vi "TestCoding.gvi"   [LabVIEW NXG 3.0.0]
panel controls:
  "Reset BER": bool
  "stop": bool
  "message length (bits)": i32 = 1000
panel indicators:
  "BER graph": f64[]
  "Mean_BER": f64
  "current BER": f64
  "Input array size": i32
  "Output array size": i32
  "error out": error
uses:
  NI::G Core::Error::Display Error.gvi
diagram:
  s1 = uninitialised  # shift register
  while {
    call "Example signal.gvi"(message length (bits)=$"message length (bits)") -> (output bit stream=w1)
    call "encode.gvi"(input bit stream=w1) -> (data out=w2, error out=w3)
    call "decode.gvi"(input data=w2, error in=w3) -> (output bit stream=w4, error out=w5)
    call "BER.gvi"(Output bit stream=w4, Input bit stream=w1, Array in=s1, Reset BER=$"Reset BER") -> (Output array size=w6, Input array size=w7, current BER=w8, Mean_BER=w9, BER graph=w10, BER array=w11)
    $"current BER" <- w8
    $Mean_BER <- w9
    $"BER graph" <- w10
    $"Input array size" <- w7
    $"Output array size" <- w6
    $"error out" <- w5
    call "Display Error.gvi"(error in=w5) -> (error?=w12)
    Logical Or(w12, $stop) -> w13
    next s1 = w11
    stop if w13
  }
