vi "TestFreqSync.gvi"   [LabVIEW NXG 3.0.0]
panel controls:
  "message length (bits)": i32 = 128
  "Samples per symbol": i32 = 16
  "frame insert index": i32 = 64
  "Insert frame": bool = TRUE
  "Error in": error
  "padding bits": i32
  "Min correlation threshold": f64
  "compensate": bool
  "frequency offset": f64
  "Barker code": enum{"5", "7", "11", "random"} = "11"
  "phase offset_2": f64
  "sfo": bool
panel indicators:
  "error out_2": error
  "BER": f64
  "output bit stream": i8[]
  "estimated phase drift": f64
  "correlation": f64[]
  "actual phase drift": f64
  "source bit stream": i8[]
  "after compensation": f64[]
  "before compensation": f64[]
  "estimated phase offset": f64
  "IQ diagram after": c128[]
  "IQ diagram before": c128[]
  "Estimated phase": f64
  "best linear fit": f64[]
  "ramp pattern": f64[]
uses:
  NI::Analysis::Statistics::Mean (DBL).gvi
  NI::Analysis::Generation::Ramp Pattern by Samples.gvi
diagram:
  call "TestSync.gvi"(message length (bits)=$"message length (bits)", Samples per symbol=$"Samples per symbol", frame insert index=$"frame insert index", Insert frame=$"Insert frame", Error in=$"Error in", frequency offset=$"frequency offset", phase offset=$"phase offset_2", Barker code=$"Barker code", Min correlation threshold=$"Min correlation threshold", padding bits=$"padding bits") -> (framesync output=w1, Training Subcodes=w2, Graph=w3, source bit stream=w4, error out=w5, phase drift=w6)
  case ($sfo) {
    frame False, Default {
      w7 = w1
      w8 = w5
    }
    frame True {
      call "SFOSync.gvi"(input signal=w1, error in=w5) -> (output signal=w7, Estimated phase=w9, best linear fit=w10, error out=w8)
      $"Estimated phase" <- w9
      $"best linear fit" <- w10
    }
  }
  case ($compensate) {
    frame False, Default {
      w11 = w8
      w12 = w7
      w13 = 0
      w14 = 0
    }
    frame True {
      call "FreqSync.gvi"(input=w7, Training codes=w2, Samples per symbol=$"Samples per symbol", Frame index=$"frame insert index", error in=w8, barker code=$"Barker code") -> (correction angles=w15, output=w12, phase drift=w13, phase offset=w14, error out=w11)
    }
  }
  $"IQ diagram after" <- w12
  Complex To Real Imaginary(x + iy=w12) -> (x=w16)
  $"after compensation" <- w16
  $"IQ diagram before" <- w1
  Complex To Real Imaginary(x + iy=w1) -> (x=w17)
  $"before compensation" <- w17
  $correlation <- w3
  call "RemoveSyncFrame.gvi"(input=w12, samples per symbol=$"Samples per symbol", sync frame index (bits)=$"frame insert index", barker code=$"Barker code") -> (output=w18)
  call "Downsampler.gvi"(input signal=w18, error in=w11, samples per symbol=$"Samples per symbol") -> (output signal=w19, error out=w20)
  case (w20) {
    frame Error, Default {
      w21 = w20
      w22 = i8[] []
    }
    frame No Error {
      call "BPSKDemod.gvi"(symbols=w19, error in=w20) -> (output bit stream=w22, error out=w21)
    }
  }
  Array Subset(array=w22, length0=$"message length (bits)") -> w23
  Is Not Equal(x=w4, y=w23) -> w24
  Boolean To Integer(Boolean=w24) -> (0, 1=w25)
  # Calculate BER
  case (w21) {
    frame Error, Default {
      w26 = w21
      w27 = -1
    }
    frame No Error {
      call "Mean (DBL).gvi"(x=w25, error in=w21) -> (mean=w27, error out=w26)
    }
  }
  $BER <- w27
  $"error out_2" <- w26
  $"estimated phase drift" <- w13
  $"actual phase drift" <- w6
  $"estimated phase offset" <- w14
  $"output bit stream" <- w23
  $"source bit stream" <- w4
  Array Size(array=w1) -> (size(s)=w28)
  Multiply(w6, w28) -> w29
  call "Ramp Pattern by Samples.gvi"(samples=w28, end=w29) -> (ramp pattern=w30)
  $"ramp pattern" <- w30
