vi "TestMSE.gvi"   [LabVIEW NXG 3.0.0]
panel controls:
  "ChannelConfig": T2 = {20, 1, 16, 0, 1, 0}
  "Reset MSE": bool
panel indicators:
  "Accumulated MSE": f64
  "IQ in": c128[]
  "IQ out": c128[]
  "MSE Graph": f64[]
types:
  T1 = cluster{"Eb/No": f64, "bits per symbol": i32, "samples per symbol": i32}
  T2 = cluster{"Noise": T1, "Frequency offset": cluster{"Frequency offset": f64}, "Timing": cluster{"Relation to fs": f64}, "Sampling rate": cluster{"fs": f64}}
uses:
  NI::G Core::Error::Is Error.gvi
diagram:
  s1 = uninitialised  # shift register
  while {
    call "Example signal.gvi"() -> (output bit stream=w1)
    call "BPSKMod.gvi"(input bit stream=w1) -> (Symbol out=w2)
    $"IQ in" <- w2
    call "Example signal.gvi"() -> (output bit stream=w3)
    call "BPSKMod.gvi"(input bit stream=w3) -> (Symbol out=w4)
    Build Cluster(0, 1, w4) -> w5
    call "Channel_basic.gvi"(inputSignal=w5, ChannelConfig=$ChannelConfig) -> (signalOutput=w6, error out=w7)
    Property Node(instance in=w6) -> ("Y"=w8)
    call "MSE.gvi"(Reset MSE=$"Reset MSE", IQ Input signal=w2, IQ Reference signal=w8, Array in=s1) -> (Accumulated MSE=w9, MSE Array=w10)
    $"Accumulated MSE" <- w9
    $"MSE Graph" <- w10
    $"IQ out" <- w8
    call "Is Error.gvi"(error in=w7) -> (error?=w11)
    next s1 = w10
    stop if w11
  }
