vi "TestModulation.gvi"   [LabVIEW NXG 3.0.0]
panel controls:
  "Samples per symbol": f64
  "message length (bits)": i32 = 1000
  "Error in": error
  "IQ rate": f64
panel indicators:
  "source bit stream": i8[]
  "Baseband signal (real part)": cluster{"t0": f64, "dt": f64, "Y": f64[]}
  "Eye Diagram (real part)": cluster{"t0": f64, "dt": f64, "Y": f64[]}[]
  "error out": error
  "BER": f64
uses:
  NI::Modulation::MT Generate Bits (Fibonacci, PN Order).gvi
  NI::Analysis::Statistics::Mean (DBL).gvi
  NI::Modulation::MT Format Eye Diagram (complex).gvi
diagram:
  To Long Integer(number=$"Samples per symbol") -> w1
  call "MT Generate Bits (Fibonacci, PN Order).gvi"(total bits=$"message length (bits)", PN sequence order=20, error in=$"Error in") -> (output bit stream=w2, error out=w3)
  call "BPSKMod.gvi"(input bit stream=w2, error in=w3) -> (Symbol out=w4, error out=w5)
  call "Upsampler.gvi"(Signal in=w4, error in=w5, Samples per symbol=w1) -> (Upsampled signal=w6, error out=w7)
  call "Downsampler.gvi"(input signal=w6, error in=w7, samples per symbol=w1) -> (output signal=w8, error out=w9)
  call "BPSKDemod.gvi"(symbols=w8, error in=w9) -> (output bit stream=w10, error out=w11)
  Is Not Equal(x=w2, y=w10) -> w12
  Boolean To Integer(Boolean=w12) -> (0, 1=w13)
  # Calculate BER
  case (w11) {
    frame Error, Default {
      w14 = w11
      w15 = -1
    }
    frame No Error {
      call "Mean (DBL).gvi"(x=w13, error in=w11) -> (mean=w15, error out=w14)
    }
  }
  $BER <- w15
  $"source bit stream" <- w2
  $"error out" <- w14
  Reciprocal(x=$"IQ rate") -> w16
  Multiply(w1, $"message length (bits)") -> w17
  Complex To Real Imaginary(x + iy=w6) -> (x=w18)
  Array Subset(array=w18, length0=w17) -> w19
  w20 = cluster{"t0": f64, "dt": f64, "Y": f64[]} {all zero or empty}
  Property Node(instance in=w20, "Y"=w19, "dt"=w16) -> (instance out=w21)  # Cluster Properties
  $"Baseband signal (real part)" <- w21
  Divide(x=$"IQ rate", y=$"Samples per symbol") -> w22
  call "MT Format Eye Diagram (complex).gvi"(waveform=w21, symbol rate=w22, eye length=2) -> (eye diagram=w23)
  $"Eye Diagram (real part)" <- w23
