vi "TestPulseShaping.gvi"   [LabVIEW NXG 3.0.0]
panel controls:
  "Samples per symbol": f64
  "filter parameter": f64 = 0.5
  "filter length": i32 = 8
  "message length (bits)": i32 = 1000
  "Error in": error
  "IQ rate": f64
panel indicators:
  "source bit stream": i8[]
  "Baseband signal (real part)": cluster{"t0": f64, "dt": f64, "Y": f64[]}
  "Eye Diagram (real part)": cluster{"t0": f64, "dt": f64, "Y": f64[]}[]
  "error out": error
uses:
  NI::Modulation::MT Generate Bits (Fibonacci, PN Order).gvi
  NI::Modulation::MT Format Eye Diagram (complex).gvi
diagram:
  call "MT Generate Bits (Fibonacci, PN Order).gvi"(total bits=$"message length (bits)", PN sequence order=20, error in=$"Error in") -> (output bit stream=w1, error out=w2)
  $"source bit stream" <- w1
  Reciprocal(x=$"IQ rate") -> w3
  To Long Integer(number=$"Samples per symbol") -> w4
  Multiply(w4, $"message length (bits)") -> w5
  call "BPSKMod.gvi"(input bit stream=w1, error in=w2) -> (Symbol out=w6, error out=w7)
  call "Upsampler.gvi"(Signal in=w6, error in=w7, Samples per symbol=w4) -> (Upsampled signal=w8, error out=w9)
  call "PulseShaping.gvi"(Signal in=w8, Samples per symbol=w4, filter parameter=$"filter parameter", filter length=$"filter length", error in=w9, tx or rx="Tx") -> (signal out=w10, error out=w11)
  call "PulseShaping.gvi"(Signal in=w10, Samples per symbol=w4, filter parameter=$"filter parameter", filter length=$"filter length", error in=w11, tx or rx="Rx") -> (signal out=w12, error out=w13)
  Complex To Real Imaginary(x + iy=w12) -> (x=w14)
  Array Subset(array=w14, length0=w5) -> w15
  w16 = cluster{"t0": f64, "dt": f64, "Y": f64[]} {all zero or empty}
  Property Node(instance in=w16, "Y"=w15, "dt"=w3) -> (instance out=w17)  # Cluster Properties
  $"Baseband signal (real part)" <- w17
  Divide(x=$"IQ rate", y=$"Samples per symbol") -> w18
  call "MT Format Eye Diagram (complex).gvi"(waveform=w17, symbol rate=w18, eye length=2, error in=w13) -> (eye diagram=w19, error out=w20)
  $"Eye Diagram (real part)" <- w19
  $"error out" <- w20
