vi "TestScrambler.gvi"   [LabVIEW NXG 3.0.0]
panel controls:
  "error in": error
panel indicators:
  "error out": error
  "output": u8[]
  "input bit stream": i8[]
  "current BER": f64
  "scrambled": u8[]
diagram:
  Random Number() -> (number (0 to 1)=w1)
  Multiply(w1, 1000) -> w2
  call "Example signal.gvi"(message length (bits)=1000, seed in=w2) -> (output bit stream=w3)
  call "FrameScrambler.gvi"(input=w3, error in=$"error in") -> (output=w4, error out=w5)
  call "FrameScrambler.gvi"(input=w4, error in=w5) -> (output=w6, error out=w7)
  call "BER.gvi"(Output bit stream=w3, Input bit stream=w6) -> (current BER=w8)
  $"current BER" <- w8
  $"input bit stream" <- w3
  $output <- w6
  $"error out" <- w7
  $scrambled <- w4
