vi "TestSource.gvi"   [LabVIEW NXG 3.0.0]
panel controls:
  "error in": error
  "stop": bool
  "port": u16 = 36363
  "net address": string = "127.0.0.1"
  "error in_2": error
  "stop_2": bool
panel indicators:
  "Error out": error
  "element": u8[]
  "sent output": u8[]
  "received packet": u8[]
uses:
  source.mli::source matlab
  sink.mli::sink matlab
diagram:
  Obtain Queue(element data type=u8[] []) -> (queue out=w1)
  Obtain Queue(element data type=u8[] []) -> (queue out=w2)
  s1 = w1  # shift register
  s2 = uninitialised  # shift register
  s3 = $"error in"  # shift register
  s4 = w2  # shift register
  while {
    call "Source.gvi"(queue in=s1, last message=s2, error in=s3) -> (queue out_2=w3, current messsage=w4, received packet=w5, error out=w6)
    Enqueue Element(element=w4, queue=s4) -> (queue out=w7)
    $"received packet" <- w5
    $element <- w4
    Logical Or(w6, $stop) -> w8
    next s1 = w3
    next s2 = w4
    next s3 = w6
    next s4 = w7
    stop if w8
  }
  w9 = $port
  w10 = $"net address"
  # very important
  Udp Open(error in=$"error in_2", net address=w10, port=0) -> (connection ID=w11)
  s5 = $"error in"  # shift register
  s6 = w11  # shift register
  s7 = w2  # shift register
  while {
    call "Sink.gvi"(queue=s7, connection ID in=s6, error in=s5, net address=w10, port=w9) -> (queue out=w12, output=w13, error out_2=w14)
    $"sent output" <- w13
    Logical Or(w14, $stop_2) -> w15
    next s5 = w14
    next s7 = w12
    stop if w15
  }
  Udp Close(connection ID=s6)
  # Call matlab script
  $"Error out" <- s5
  disable {
    frame Disabled {
      call "source matlab"() -> (data=w16)
      call "sink matlab"(data=w16)
    }
    frame Enabled { }
  }
