vi "TestSync.gvi"   [LabVIEW NXG 3.0.0]
inputs:
  "message length (bits)": i32 = 88
  "Error in": error
  "Samples per symbol": i32 = 16
  "frame insert index": i32 = 44
  "Barker code": enum{"5", "7", "11", "random"} = "random"
  "Min correlation threshold": f64
  "padding bits": i32 = 50
  "Insert frame": bool
  "frequency offset": f64
  "phase offset": f64
outputs:
  "Training Subcodes": c128[][]
  "framesync output": c128[]
  "error out": error
  "Graph": f64[]
  "source bit stream": i8[]
  "phase drift": f64
  "channel": c128[]
panel controls:
  "sync frame buffer (symbols)": i32 = 16
panel indicators:
  "BER": f64
  "output bit stream": i8[]
  "max index(es)": i32
  "Index should be at": i32
uses:
  NI::Modulation::MT Generate Bits (Fibonacci, PN Order).gvi
  NI::Analysis::Generation::Ramp Pattern by Samples.gvi
  NI::Analysis::Statistics::Mean (DBL).gvi
diagram:
  Multiply(f64 default, $"frequency offset") -> w1
  # optional carrier frequency shift
  $"phase drift" <- w1
  Multiply($"padding bits", $"Samples per symbol") -> w2
  Initialize Array(element=0+0i, size=w2) -> w3
  Random Number() -> (number (0 to 1)=w4)
  Multiply(w4, 1000) -> w5
  To Long Integer(number=w5) -> w6
  call "MT Generate Bits (Fibonacci, PN Order).gvi"(reset?=TRUE, total bits=$"message length (bits)", PN sequence order=10, seed in=w6, error in=$"Error in") -> (output bit stream=w7, error out=w8)
  call "BPSKMod.gvi"(input bit stream=w7, error in=w8) -> (Symbol out=w9, error out=w10)
  case ($"Insert frame") {
    frame False, Default {
      w11 = w9
    }
    frame True {
      call "SyncFrameInserter.gvi"(Signal in=w9, insert index=$"frame insert index", Barker code=$"Barker code") -> (Signal out=w11)
    }
  }
  call "Upsampler.gvi"(Signal in=w11, Samples per symbol=$"Samples per symbol", error in=w10) -> (Upsampled signal=w12, error out=w13)
  Insert Into Array(inArray=w12, index0=0, new=w3) -> w14
  Array Size(array=w14) -> (size(s)=w15)
  Insert Into Array(inArray=w14, index0=w15, new=w3) -> w16
  # add padding before and after message to simulate a IQ fetch
  call "PulseShaping.gvi"(Signal in=w16, Samples per symbol=$"Samples per symbol", tx or rx="Tx") -> (signal out=w17)
  call "PulseShaping.gvi"(Signal in=w17, Samples per symbol=$"Samples per symbol", tx or rx="Rx") -> (signal out=w18)
  call "NormalizeVector.gvi"(Vector=w18) -> (Normalized Vector=w19)
  $channel <- w19
  Add($"frame insert index", $"sync frame buffer (symbols)") -> w20
  Multiply(w20, $"Samples per symbol") -> w21
  Add(w2, w21) -> w22
  $"Index should be at" <- w22
  Array Size(array=w19) -> (size(s)=w23)
  Multiply(w1, w23) -> w24
  call "Ramp Pattern by Samples.gvi"(samples=w23, end=w24) -> (ramp pattern=w25)
  Add($"phase offset", w25) -> w26
  Polar To Complex(r=1, theta=w26) -> (r * e^(i*theta)=w27)
  Multiply(w19, w27) -> w28
  call "FrameSync.gvi"(input signal=w28, samples per symbol=$"Samples per symbol", sync frame buffer (symbols)=$"sync frame buffer (symbols)", error in=w13, sync frame index (symbols)=$"frame insert index", barker code=$"Barker code", Min correlation=$"Min correlation threshold") -> (output signal=w29, Correlation=w30, max index=w31, Training Subcodes=w32, error out=w33)
  call "RemoveSyncFrame.gvi"(input=w29, samples per symbol=$"Samples per symbol", sync frame index (bits)=$"frame insert index", barker code=$"Barker code") -> (output=w34)
  call "Downsampler.gvi"(input signal=w34, error in=w33, samples per symbol=$"Samples per symbol") -> (output signal=w35, error out=w36)
  case (w36) {
    frame Error, Default {
      w37 = w36
      w38 = i8[] []
    }
    frame No Error {
      call "BPSKDemod.gvi"(symbols=w35, error in=w36) -> (output bit stream=w38, error out=w37)
    }
  }
  Array Subset(array=w38, length0=$"message length (bits)") -> w39
  Is Not Equal(x=w7, y=w39) -> w40
  Boolean To Integer(Boolean=w40) -> (0, 1=w41)
  # Calculate BER
  case (w37) {
    frame Error, Default {
      w42 = w37
      w43 = -1
    }
    frame No Error {
      call "Mean (DBL).gvi"(x=w41, error in=w37) -> (mean=w43, error out=w42)
    }
  }
  $BER <- w43
  $"framesync output" <- w29
  $"source bit stream" <- w7
  $"error out" <- w42
  $"Training Subcodes" <- w32
  $"max index(es)" <- w31
  $"output bit stream" <- w39
  Absolute Value(x=w30) -> w44
  $Graph <- w44
