vi "TestUDP.gvi"   [LabVIEW NXG 3.0.0]
panel controls:
  "error in": error
  "source port": u16 = 26363
  "net address_2": string = "127.0.0.1"
  "sink port": u16 = 36363
  "packet length(bits)": u32 = 128
panel indicators:
  "Error out": error
  "string": string
  "size(s)": i32
  "number elements in queue": i32
  "loop iteration": i32
uses:
  NI::Modulation::MT Pack Bits.gvi
  NI::G Core::Error::Multiplex Errors.gvi
diagram:
  Obtain Queue(element data type=u8[] []) -> (queue out=w1)
  Obtain Notifier(element data type=bool TRUE, error in=$"error in", name="error") -> (error out=w2, notifier out=w3)
  Obtain Queue(element data type=u8[] []) -> (queue out=w4)
  s1 = u8[] []  # shift register
  while {
    Dequeue Element(queue=w1) -> (element=w5)
    call "packetizer.gvi"(array=w5, packet size=$"packet length(bits)", last bits=s1) -> (packets=w6)
    s2 = u8[] []  # shift register
    for (iteration -> i1) {
      w7 = each element of w6
      Array Size(array=w7) -> (size(s)=w8)
      $"size(s)" <- w8
      Is Greater Than 0(x=w8) -> w9
      case (w9) {
        frame False, Default { }
        frame True {
          call "MT Pack Bits.gvi"(input bit stream=w7, bits per integer=8, packed bit order="MSB first", integer format="Unsigned") -> (output integers=w10)
          Byte Array To String(encoding="Extended ASCII", unsigned byte array=w10) -> (string=w11)
          $string <- w11
        }
      }
      Insert Into Array(inArray=s2, new=w7) -> w12
      $"loop iteration" <- i1
      Enqueue Element(element=w7, queue=w4)
      next s2 = w12
    }
    Get Notifier Status(notifier=w3) -> (latest notification=w13)
    Get Queue Status(queue=w4) -> (# elements in queue=w14)
    $"number elements in queue" <- w14
    stop if w13
  }
  call "Source.gvi"(queue=w1, notifier ref=w3, error in=w2, net address=$"net address_2", source port=$"source port") -> (error out=w15)
  call "Sink.gvi"(queue=w4, notifier ref=w3, error in=w2, net address_2=$"net address_2", sink port=$"sink port") -> (error out=w16)
  call "Multiplex Errors.gvi"(error in 1=w16, error in 2=w15) -> (error out=w17)
  Release Notifier(error in (no error)=w17, notifier=w3) -> (error out=w18)
  $"Error out" <- w18
