vi "BPSKMod.gvi"   [LabVIEW NXG 3.0.0]
inputs:
  "input bit stream": i32[]
  "error in": error
outputs:
  "Symbol out": c128[]
  "error out": error
uses:
  NI::Modulation::MT Map Bits to PSK Symbols.gvi
diagram:
  call "MapBSPK.gvi"(error in=$"error in") -> (symbol map=w1, error out=w2)
  call "MT Map Bits to PSK Symbols.gvi"(input bit stream=$"input bit stream", symbol map=w1, error in=w2) -> (symbols=w3, error out=w4)
  $"Symbol out" <- w3
  $"error out" <- w4
