vi "PackUDP.gvi"   [LabVIEW NXG 3.0.0]
panel controls:
  "Input": u8[]
  "packet length": u32 = 26363
panel indicators:
  "Output": u8[][]
diagram:
  w1 = $"packet length"
  Array Size(array=$Input) -> (size(s)=w2)
  Divide(x=w2, y=w1) -> w3
  Round Toward Positive Infinity(x=w3) -> w4
  To Long Integer(number=w4) -> w5
  Multiply(w5, w1) -> w6
  Subtract(x=w6, y=w2) -> w7
  call "ZeroPaddingInt.gvi"(Input=$Input, Padding length=w7, samples per symbol=1, pad beginning=FALSE) -> (output array=w8)
  for (N = w5) {
    Multiply(w1, w5) -> w10
    Array Subset(array=w8, index0=w10, length0=w1) -> w11
    append w11 to w9
  }
  $Output <- w9
