vi "Source.gvi"   [LabVIEW NXG 3.0.0]
inputs:
  "queue": Queue<u8[]>
  "error in": error
  "source port": u16 = 26363
  "net address": string = "127.0.0.1"
  "pack bits": bool = TRUE
  "notifier ref": Notifier<bool>
outputs:
  "error out": error
  "element": u8[]
panel controls:
  "packet length": u32 = 26363
panel indicators:
  "source iteration": i32
uses:
  NI::Modulation::MT UnPack Bits.gvi
  NI::G Core::Error::Filter Error Code.gvi
diagram:
  Udp Open(error in=$"error in", net address=$"net address", port=$"source port") -> (connection ID=w1, error out=w2)
  s1 = w2  # shift register
  s2 = $queue  # shift register
  s3 = w1  # shift register
  s4 = $"notifier ref"  # shift register
  while (iteration -> i1) {
    Get Notifier Status(notifier=s4) -> (latest notification=w3)
    case (w3) {
      frame True {
        w4 = s2
        w5 = s3
        w6 = s1
        w7 = s4
      }
      frame False {
        Udp Read I Pv 6 Binary(connection ID=s3, error in=s1, timeout ms=100) -> (connection ID out=w5, data out=w8, error out=w9)
        case ($"pack bits") {
          frame False, Default {
            w10 = w8
            w11 = w9
          }
          frame True {
            call "MT UnPack Bits.gvi"(input integers=w8, bits per integer=8, packed bit order="MSB first", integer format="Unsigned", error in=w9) -> (output bit stream=w12, error out=w11)
            To Unsigned Byte Integer(number=w12) -> w10
          }
        }
        Enqueue Element(element=w10, error in=w11, queue=s2) -> (error out=w13, queue out=w4)
        # Ignore timeout error
        call "Filter Error Code.gvi"(error in=w13, code to clear=56) -> (error out=w14)
        call "NotifyError.gvi"(notifier ref=s4, error in=w14) -> (Error out=w6)
        $element <- w8
        w7 = s4
      }
    }
    $"source iteration" <- i1
    next s1 = w6
    next s2 = w4
    next s3 = w5
    next s4 = w7
    stop if w3
  }
  Udp Close(connection ID=s3, error in=s1) -> (error out=w15)
  $"error out" <- w15
