vi "SyncFrameInserter.gvi"   [LabVIEW NXG 3.0.0]
inputs:
  "Signal in": c128[]
  "Barker code": enum{"5", "7", "11", "random"} = "random"
  "insert index": i32
outputs:
  "Signal out": c128[]
diagram:
  call "BarkerCode.gvi"(barker code=$"Barker code") -> (code=w1)
  To Double Precision Complex(number=w1) -> w2
  Insert Into Array(inArray=$"Signal in", index0=$"insert index", new=w2) -> w3
  $"Signal out" <- w3
