vi "TransmitterBlock.gvi"   [LabVIEW NXG 3.0.0]
panel controls:
  "IQ rate": f64 = 160000
  "carrier frequency": f64 = 2450000000
  "Active antenna": string = "TX1"
  "stop": bool
  "Device name": string = "USRP_06"
  "gain": f64
  "RF channel": string = "0"
  "filter parameter": f64 = 0.5
  "filter length": i32 = 8
  "Symbol rate (sym/s)": i32 = 10000
  "Barker insert index": i32 = 64
  "message length (bits)": i32 = 128
  "Barker code": enum{"5", "7", "11", "random"} = "11"
  "Padding length": i32 = 40
  "encode": bool
  "Frame sync": bool = TRUE
  "Send sound": bool
  "Interleaver": bool
  "source port": u16 = 26363
  "net address_2": string = "127.0.0.1"
  "preamble?": bool = TRUE
  "Preamble code": enum{"5", "7", "11", "random"} = "7"
  "Flush_queue": bool
panel indicators:
  "actual IQ rate": f64
  "actual carrier frequency": f64
  "actual gain (dB)": f64
  "error out": error
  "Baseband Waveform (absolute value)": waveform<f64>
  "IQ diagram": c128[]
  "actual message length": i32
  "Transmitting": bool
  "number elements in queue": i32
  "milliseconds": u32
  "FPS": f64
  "Underflow?": bool  # specific error cleared? indicates whether the error referenced by specific error code to clear has been cleared.
  "slope": f64
uses:
  NI::USRP::niUSRP Open Tx Session.gvi
  NI::USRP::niUSRP Configure Signal.gvi
  NI::Analysis::Generation::Ramp Pattern by Samples.gvi
  NI::Analysis::Fitting::Linear Fit.gvi
  NI::USRP::niUSRP Write Tx Data (CDB).gvi
  NI::G Core::Error::Filter Error Code.gvi
  NI::USRP::niUSRP Close Session.gvi
  NI::G Core::Error::Multiplex Errors.gvi
diagram:
  w1 = $"RF channel"
  call "niUSRP Open Tx Session.gvi"(device names=$"Device name") -> (session handle out=w2, error out=w3)
  Property Node(instance in=w2, "niUSRP"=w1, error in=w3) -> (error out=w4, instance out=w5)
  call "niUSRP Configure Signal.gvi"(active antenna=$"Active antenna", session handle=w5, error in=w4, IQ rate=$"IQ rate", carrier frequency=$"carrier frequency", gain=$gain, channel list=w1) -> (session handle out=w6, error out=w7, coerced IQ rate=w8, coerced carrier frequency=w9, coerced gain=w10)
  Obtain Notifier(element data type=bool TRUE, error in=w7, name="error") -> (error out=w11, notifier out=w12)
  Obtain Queue(element data type=u8[] []) -> (queue out=w13)
  call "Source.gvi"(queue=w13, notifier ref=w12, error in=w11, net address=$"net address_2", source port=$"source port") -> (error out=w14)
  Initialize Array(element=0, size=500) -> w15
  s1 = uninitialised  # shift register
  s2 = w15  # shift register
  s3 = 1  # shift register
  s4 = uninitialised  # shift register
  while (iteration -> i1) {
    Tick Count() -> (timer value=w16)
    Subtract(x=w16, y=s1) -> w17
    Reciprocal(x=w17) -> w18
    Multiply(w18, 1000) -> w19
    $FPS <- w19
    $milliseconds <- w17
    Get Notifier Status(notifier=w12) -> (latest notification=w20)
    case (w20) {
      frame True {
        w21 = w7
        w22 = w6
        w23 = s2
        w24 = s3
      }
      frame False {
        case ($Flush_queue) {
          frame False, Default { }
          frame True {
            Flush Queue(queue=w13)
          }
        }
        case ($"Send sound") {
          frame False, Default {
            call "Example signal.gvi"(message length (bits)=$"message length (bits)") -> (output bit stream=w25)
            w26 = w7
            w27 = TRUE
            w23 = s2
            w24 = s3
            w28 = 0
          }
          frame True {
            Get Queue Status(queue=w13) -> (# elements in queue=w29)
            $"number elements in queue" <- w29
            Dequeue Element(queue=w13, timeout in ms=15) -> (element=w25)
            Subtract(x=50, y=200) -> w30
            Divide(x=10, y=w30) -> w31
            Multiply(w29, w31) -> w32
            Add(20, w32) -> w28
            Quotient And Remainder(x=i1, y=500) -> (x-y*floor(x/y)=w33)
            Replace Array Subset(inArray=s2, index=w33, new=w29) -> w23
            call "Ramp Pattern by Samples.gvi"(samples=500, end=500, exclude end=TRUE) -> (ramp pattern=w34)
            call "Linear Fit.gvi"(y=w23, x=w34) -> (slope=w24)
            $slope <- w24
            w26 = w7
            w27 = TRUE
          }
        }
        Array Size(array=w25) -> (size(s)=w35)
        Subtract(x=$"message length (bits)", y=w35) -> w36
        call "ZeroPaddingInt.gvi"(Input=w25, Padding length=w36, samples per symbol=1, pad beginning=FALSE, pad end=TRUE) -> (output array=w37)
        Is Greater(x=w35, y=0) -> w38
        Logical And(w38, w27) -> w39
        case (w39) {
          frame False, Default {
            w40 = $stop
            w21 = w26
            w22 = w6
          }
          frame True {
            call "Transmitter.gvi"(filter parameter=$"filter parameter", filter length=$"filter length", Interleaver=$Interleaver, input bit stream=w37, IQ rate=w8, Symbol rate (sym/s)=$"Symbol rate (sym/s)", Frame sync=$"Frame sync", error in=w26, Barker code=$"Barker code", Barker insert index=$"Barker insert index", encode=$encode, preamble?=$"preamble?", Preamble code=$"Preamble code") -> (signal out=w41, IQ diagram=w42, Symbols=w43, error out=w44)
            $"IQ diagram" <- w42
            Array Size(array=w43) -> (size(s)=w45)
            Multiply(2, $"Padding length") -> w46
            Divide(x=w8, y=$"Symbol rate (sym/s)") -> w47
            Divide(x=w46, y=w47) -> w48
            Add(w48, w45) -> w49
            Divide(x=w49, y=$"Symbol rate (sym/s)") -> w50
            Multiply(w50, 1000) -> w51
            Add(w51, w28) -> w52
            Wait(time to wait=w52)
            call "ZeroPaddingDbl.gvi"(Input=w41, Padding length=$"Padding length", samples per symbol=w47) -> (output array=w53)
            call "niUSRP Write Tx Data (CDB).gvi"(session handle=w6, error in=w44, data=w53, end of data?=$stop, channel list=w1) -> (session handle out=w22, error out=w54)
            # ignore underflow
            call "Filter Error Code.gvi"(error in=w54, code to clear=-1074118645) -> (error out=w21, error cleared?=w55)
            $"Underflow?" <- w55
            Absolute Value(x=w53) -> w56
            Reciprocal(x=$"Symbol rate (sym/s)") -> w57
            Build Waveform Node(Y=w56, dt=w57) -> (output waveform=w58)
            $"Baseband Waveform (absolute value)" <- w58
            w40 = $stop
          }
        }
        call "NotifyError.gvi"(notifier ref=w12, Notify anyway=w40, error in=w21)
        $"actual message length" <- w35
        $Transmitting <- w39
      }
    }
    next s1 = w16
    next s2 = w23
    next s3 = w24
    next s4 = w17
    stop if w20
  }
  call "niUSRP Close Session.gvi"(session handle=w22, error in=w21) -> (error out=w59)
  call "Multiplex Errors.gvi"(error in 1=w14, error in 2=w59) -> (error out=w60)
  Release Notifier(error in (no error)=w60, notifier=w12) -> (error out=w61)
  $"error out" <- w61
  $"actual IQ rate" <- w8
  $"actual carrier frequency" <- w9
  $"actual gain (dB)" <- w10
