vi "encode.gvi"   [LabVIEW NXG 3.0.0]
inputs:
  "input bit stream": i8[]
  "error in": error
  "code type": enum{"reed-solomon", "convolutional", "no code"} = "convolutional"
  "convolutional rate": enum{"1/2", "1/3", "1/4", "2/3", "3/4"} = "1/2"
  "convolutional constraint length": i32 = 3
  "RS code word length (n), symbols": i32 = 7
  "RS data word length (k), symbols": i32 = 3
outputs:
  "data out": i32[]
  "error out": error
uses:
  NI::Modulation::MT Convolutional Encoder (Rate).gvi
  NI::Modulation::MT RS Symbol Encoder (normal).gvi
diagram:
  case ($"code type") {
    frame "convolutional", Default {
      call "MT Convolutional Encoder (Rate).gvi"(input bit stream=$"input bit stream", rate=$"convolutional rate", constraint length=$"convolutional constraint length", error in=$"error in") -> (output bit stream=w1, error out=w2)
    }
    frame "reed-solomon" {
      call "MT RS Symbol Encoder (normal).gvi"(input symbols=$"input bit stream", code word length (n), symbols=$"RS code word length (n), symbols", data word length (k), symbols=$"RS data word length (k), symbols", error in=$"error in") -> (output symbols=w1, error out=w2)
    }
    frame "no code" {
      w1 = $"input bit stream"
      w2 = $"error in"
    }
  }
  $"data out" <- w1
  $"error out" <- w2
