vi "packetizer.gvi"   [LabVIEW NXG 3.0.0]
inputs:
  "array": u8[]
  "packet size": i32
  "last bits": u8[]
outputs:
  "packets": u8[][]
  "next bits": u8[]
diagram:
  Array Size(array=$array) -> (size(s)=w1)
  Quotient And Remainder(x=w1, y=$"packet size") -> (floor(x/y)=w2, x-y*floor(x/y)=w3)
  Subtract(x=w1, y=w3) -> w4
  Array Subset(array=$array, index0=w4) -> w5
  $"next bits" <- w5
  Insert Into Array(inArray=$array, index0=0, new=$"last bits") -> w6
  Round Toward Negative Infinity(x=w2) -> w7
  s1 = 0  # shift register
  for (N = w7) {
    Multiply($"packet size", s1) -> w9
    Array Subset(array=w6, index0=w9, length0=$"packet size") -> w10
    Increment(x=s1) -> w11
    append w10 to w8
    next s1 = w11
  }
  $packets <- w8
